# Grasshopper definition 01_ellipse-ui.gh (Grasshopper 1.0.8)
# plug-ins: Human

# ---- group: UI
number_slider = Slider(2, range=1..10)
number_slider_2 = Slider(5, range=1..10)
point = Point(Point(0, 0, 0))

# ----
ellipse = Ellipse(Plane=point, Radius1=number_slider_2, Radius2=number_slider)  # -> Ellipse, Focus1, Focus2
bake_geometry = BakeGeometry(Bake=invert(False), Geometry=ellipse.Ellipse, DeleteOldBakes=True, PreserveTrees=False)
