# Grasshopper definition Ship Resize.gh (Grasshopper 1.0.8)

# ---- group: UI
width = Slider(100, range=50..150)
length = Slider(100, range=50..150)
height = Slider(100, range=50..150)

# ----
brep = Brep(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)
xy_plane = XYPlane(Origin=Point(0, 0, 0))
scale_nu = ScaleNU(Geometry=brep, Plane=xy_plane, ScaleX=expr("x/100", length), ScaleY=expr("x/100", width), ScaleZ=expr("x/100", height))  # -> Geometry, Transform
